# Grasshopper definition Cells.gh (Grasshopper 1.0.7)
# plug-ins: Kangaroo2 Components

mesh_cover_seed = Slider(191, range=0..1000)
number_slider = Slider(9, range=1..10)
Z = GetInteger(number_slider, AtLeast=1, AtMost=1, Maximum=2147483647, Minimum=-2147483648, TreeAccess=False)
Y = GetInteger(Slider(9, range=1..10), AtLeast=1, AtMost=1, Maximum=2147483647, Minimum=-2147483648, TreeAccess=False)
X = GetInteger(Slider(9, range=1..10), AtLeast=1, AtMost=1, Maximum=2147483647, Minimum=-2147483648, TreeAccess=False)
covered_cells = GetInteger(mesh_cover_seed, AtLeast=1, AtMost=1, Maximum=2147483647, Minimum=-2147483648, TreeAccess=False)
pt = ConstructPoint(XCoordinate=0, YCoordinate=0, ZCoordinate=number_slider)
box = CenterBox(Base=pt, X=X, Y=Y, Z=Z)
number_slider_2 = Slider(0.5, range=0..2)
pop3d = Populate3D(Region=box, Count=Slider(20, range=0..500), Seed=1)
prox = Proximity3D(Points=pop3d, Group=Slider(5, range=0..10))  # -> Links, Topology
loft = Loft(Curves=prox.Links, Options={Adjust=False, Closed=False, LoftEnds=0, LoftSimp=0, LoftType=3, Rebuild=10, Refit=0.01})  # -> flatten(Loft)
pipe = Pipe(Curve=prox.Links, Radius="0.05", Caps=2)
lng = ListLength(List=loft)
multiplication = Multiplication(A=lng, B=0.6)
wires = BrepWireframe(Brep=pipe, Density=Slider(2, range=0..10))  # -> flatten(Wireframe)
reduce = RandomReduce(List=loft, Reduction=multiplication, Seed=mesh_cover_seed)
curvepoint = PointOnCurve(wires, parameter=0.5)
pt_2 = ConstructPoint(XCoordinate=0, YCoordinate=0, ZCoordinate=0)
preview = CustomPreview(Geometry=pipe, Material=ColourSwatch(SwatchColor=RGB(13, 0, 0)))
merge = Merge(Data1=reduce, Data2=pipe)
pull = PullPoint(Point=curvepoint, Geometry=pt_2, ClosestOnly=True)  # -> ClosestPoint, Distance
bnd = Bounds(Numbers=pull.Distance)
clean = CombineClean(Meshes=merge)
remap = RemapNumbers(Value=pull.Distance, Source=bnd, Target=Domain(0, 1))  # -> Mapped, Clipped
gradient = Gradient(
    LowerLimit=0,
    UpperLimit=1,
    Parameter=remap.Mapped,
    stops=[0: RGB(0, 34, 255), 0.5: RGB(255, 0, 85), 1: RGB(255, 153, 0)])
mesh = Mesh(clean)
panel = Panel(gradient)
c_script = CSharpScript(crv=wires, color=gradient)  # -> out, A; inputs crv: Curve, color: Color
# ---------- c_script: C# ----------
    var c = color.R + "," + color.G + "," + color.B;
    crv.SetUserString("color", c);
    A = crv;
# ---------- end c_script ----------
curve = Curve(flatten(c_script.A))
demesh = DeconstructMesh(Mesh=mesh)  # -> Vertices, Faces, Colours, Normals
context_bake = ContextBake(Geometry=curve)
conmesh = ConstructMesh(Vertices=demesh.Vertices, Faces=demesh.Faces, Colours=ColourSwatch(SwatchColor=RGBA(63, 52, 66, 0)))
clean_2 = CombineClean(Meshes=conmesh)
context_bake_2 = ContextBake(Geometry=clean_2)
